# Grasshopper definition example.gh (Grasshopper 1.0.7)
# plug-ins: THERB-GH

# ----
# step0. デフォルトの入力値を取得
# 0-2. スケジュールに関するデータをサーバから取得
toggle = BooleanToggle(True)
# 0-1. 壁体構成のデフォルトデータをサーバから取得
toggle_2 = BooleanToggle(True)
readenvelope = ReadEnvelope(Run=toggle_2)
readschedule = ReadSchedule(Run=toggle)
item = ListItem(List=readschedule, Index=Slider(0, range=0..1), Wrap=True)

panel = Panel(readschedule)
panel_2 = Panel(readenvelope)
item_2 = ListItem(List=readenvelope, Index=Slider(0, range=0..10), Wrap=True)

vec = Vector(Vector(0, 29.09847992, 0))
updatesetting = UpdateSetting(
    North_direction=vec,
    Start_month=Slider(1, range=0..1),
    End_month=Slider(12, range=0..100),
    VentilationRate_ACH=Slider(0.5, range=0..1))  # -> Setting, T_dat

# ----
# 1-2.計算に必要な諸条件（北の方角、計算期間）を指定
number_slider = Slider(0.1, range=0..0.1)
# step1. ジオメトリ、条件入力
# 1-1. ジオメトリ情報を入力
brep = Brep(<brep referenced from the Rhino model>)
srf = Surface(<surface referenced from the Rhino model>)
srf_2 = Surface(<surface referenced from the Rhino model>)

exports = ExportS(Schedule=item)

# ----
# step1B. 壁体構成を編集する
# 2-1. 編集するFaceを選択
# 2-2. 壁体構成データを取得
# 2-3. 更新する壁体構成データを選択
number_slider_2 = Slider(4, range=0..15)
item_3 = ListItem(Index=number_slider_2, Wrap=True)
panel_3 = Panel(item_3)

readconstruction = ReadConstruction(Run=Toggle(True))
therb = THERB(
    Boxes=brep,
    _windows=srf,
    _overhangs=srf_2,
    _Envelope=item_2,
    _Constructions=readconstruction,
    Tolerance=number_slider,
    fontsize=0)

# ----
# (壁体構成を編集したい場合)
decompose = Decompose(Therb=therb)  # -> Rooms, Faces, Windows, Overhangs
filterfacebyproperty = FilterFaceByProperty(Faces=decompose.Faces, Bc=1, SurfT=0, Direction=-1)  # -> TrueFace, FalseFace
panel_4 = Panel(readconstruction)
updateconstruction = UpdateConstruction(Face=filterfacebyproperty.TrueFace, Construction=item_3)
merge = Merge(Data1=updateconstruction, Data2=filterfacebyproperty.FalseFace)  # -> flatten(Result)
compose = Compose(Rooms=decompose.Rooms, Faces=merge, Windows=decompose.Windows, Overhangs=decompose.Overhangs)

# ----
# step3. 出力をチェック
exportw = ExportW(Construction=readconstruction)
exporta = ExportA(Therb=therb)
exportb = ExportB(Therb=therb)
exportr = ExportR(Therb=therb)

panel_5 = Panel(exports)
b_datファイル書き出し = Panel(exportb)
r_datファイル書き出し = Panel(exportr)
w_datファイル書き出し = Panel(exportw)
panel_6 = Panel(exporta)

# ----
# step2. 計算開始
run_simulation = RunSimulation(
    Therb=therb,
    Constructions=readconstruction,
    Setting=updatesetting.Setting,
    Schedule=item,
    Name="api-revise",
    Run=Toggle(True))

panel_7 = Panel(run_simulation)

# ----
# step3. 計算結果をアップロード
# https://therb-frontend-amber.vercel.app/projects
uploadresult = UploadResult(Therb=therb, _Envelope=item_2, O_dat_file_path=run_simulation, Run=Toggle(False))
panel_8 = Panel(uploadresult)
